# Dynamo graph 01. Generate All System 3D Views_script.dyn (Dynamo 2.19.3.6394)
# packages: Rhythm 2024.10.1, DynamoLabCTS 1.2.5, MEPover 2024.9.25, Orchid 2.19.3.6373, Clockwork for Dynamo 2.x 2.12.2

# group: SCRIPT INFORMATION
code_block = CodeBlock()
# ---------- code_block.designscript (12 lines) ----------
//-----------SCRIPT INFORMATION-----------//
/*
Version: 1.0.0
Script Name: Generate All System 3D View
Developed by: AECOM MY - Amer Nasir, Tuah Hamid
Date: 17/03/2025

Version: 1.0.1
Date: 21/04/2025
Change log: Removed FCU from valid system names

*/;
# ----------------------------------------
code_block_2 = CodeBlock()
# ---------- code_block_2.designscript (10 lines) ----------
//-----------DEPENDENCIES-----------//
/*
Data-Shapes            || 2025.3.118
Genius Loci            || 2024.2.114
Orchid                 || 2.19.3.6373
Clockwork              || 2.12.2
MEPover                || 2024.9.25
DynamoIronPython2.7	   || 2.4.0
Rhythm                 || 2024.10.1
*/;
# ----------------------------------------

# group: GET MECH EQUIPMENT ELEMENTS
code_block_3 = CodeBlock { "Mechanical Equipment"; }
byName = Category.ByName(name=code_block_3)
all_elements_of_category = ElementsOfCategory(Category=byName)

# group: FILTER VALID MECH EQUIPMENTS
code_block_4 = CodeBlock { "Equipment Name"; }
getParameterValueByName = Element.GetParameterValueByName(element=all_elements_of_category, parameterName=code_block_4)
code_block_5 = CodeBlock()
# ---------- code_block_5.designscript (9 lines) ----------
[
"AHU",
"OAU",
"EAF",
"FAF",
"SEF",
"GPF",
"SPF"
];
# ----------------------------------------
get_valid_equipments = Python(IN[0]=getParameterValueByName, IN[1]=all_elements_of_category, IN[2]=code_block_5)  # CPython3
# ---------- get_valid_equipments.python (23 lines) ----------
# Load the Python Standard and DesignScript Libraries
import sys
import clr
clr.AddReference('ProtoGeometry')
from Autodesk.DesignScript.Geometry import *

element_system_names = IN[0]
elements = IN[1]
valid_system_names = IN[2]

bool_flag = []
valid_elements = []
invalid_elements = []

for name, ele in zip(element_system_names, elements):
    if name in valid_system_names:
        bool_flag.append(True)
        valid_elements.append(ele)
    else:
        bool_flag.append(False)
        invalid_elements.append(ele)

OUT = bool_flag, valid_elements, invalid_elements
# ----------------------------------------
code_block_6 = CodeBlock(data=get_valid_equipments) { valid = data[1]; }
code_block_7 = CodeBlock { "Equipment Code ID"; }
getParameterValueByName_2 = Element.GetParameterValueByName(element=code_block_6, parameterName=code_block_7)
get_elements_with_valid_code_id = Python(IN[0]=code_block_6, IN[1]=getParameterValueByName_2)  # CPython3
# ---------- get_elements_with_valid_code_id.python (21 lines) ----------
# Load the Python Standard and DesignScript Libraries
import sys
import clr
clr.AddReference('ProtoGeometry')
from Autodesk.DesignScript.Geometry import *

elements = IN[0]
element_ids = IN[1]

valid_elements = []
valid_ids = []
invalid_elements = []

for id, ele in zip(element_ids, elements):
    if id:
        valid_elements.append(ele)
        valid_ids.append(id)
    else:
        invalid_elements.append(ele)

OUT = valid_elements, valid_ids, invalid_elements
# ----------------------------------------
code_block_8 = CodeBlock(data=get_elements_with_valid_code_id)
# ---------- code_block_8.designscript (22 lines) ----------
data;

// check any invalid elements
invalidList = data[2];
isEmpty = List.IsEmpty(invalidList);
errorMessage = "Error! Please view Checking Schedule ^_^";

// if invalid list contains value, (isEmpty == false) terminate script
// else statement as terminus
allowData = [Imperative]{
if (isEmpty == true) // change this bool for testing
	return [data[0], List.Empty, List.Empty];
else
	return [List.Empty, data[2], errorMessage];
};

"Warning!";
allowMessage = allowData[2];

//output
validElements = allowData[0];
invalidElements = allowData[1];
# ----------------------------------------
code_block_9 = CodeBlock(valid_elements=code_block_8.out7) { valid_elements[0]; }
ʳʰʸᵗʰᵐ_helpers_simpleusermessage = Rhythm.Revit.Helpers.Helpers.SimpleUserMessage(caption=code_block_8.out5, message=code_block_8.out6)

# group: GATE - CREATE SCHEDULE OF ELEMENTS WITH MISSING PARAMETER VALUES
code_block_10 = CodeBlock(invalidElements=code_block_8.out8)
# ---------- code_block_10.designscript (19 lines) ----------
// generate schedule if model contains invalid elements
invalidElements;

//is empty
isEmpty = List.IsEmpty(invalidElements);
isNull = DSCore.Object.IsNull(invalidElements);

// if list contains invalid elements,
//
// create schedule
allowCatName = [Imperative]{
if (isEmpty == false || isEmpty == null)
	return "Mechanical Equipment";
else
	return List.Empty;
};

//output
allowCatName;
# ----------------------------------------
code_block_11 = CodeBlock(bool1=code_block_10.out2) { bool1; }
watch = Watch(code_block_10.out3)
code_block_12 = CodeBlock(bool1=code_block_10.out1) { bool1; }
now = DateTime.Now()
string_from_object = FromObject(object=now)
code_block_13 = CodeBlock { ":"; "."; }
replace = String.Replace(string=string_from_object, searchFor=code_block_13.out0, replaceWith=code_block_13.out1)
code_block_14 = CodeBlock { " -- Mechanical Equipment"; }
add = replace + code_block_14
createSchedules = DynamoLab.Revit.Views.ScheduleView.CreateSchedules(categoryName=code_block_10.out3, scheduleName=add)
code_block_15 = CodeBlock()
# ---------- code_block_15.designscript (9 lines) ----------
[
"Level",
"Object ID Number",
"Equipment Code ID",
"System Name",
"Elevation from Level",
"Family",
"Family and Type"
];
# ----------------------------------------
addFields = DynamoLab.Revit.Views.ScheduleView.AddFields(dynamoSchedule=createSchedules, fieldName=code_block_15)
equal = Autodesk.Revit.DB.ScheduleFilterType.Equal()
code_block_16 = CodeBlock(view=addFields, filterType=equal) { view[0]; "Equipment Code ID"; filterType; ""; }
addFilter = DynamoLab.Revit.Views.ScheduleView.AddFilter(dynamoSchedule=code_block_16.out0, fieldName=code_block_16.out1, filterType=code_block_16.filterType, filterInformation=code_block_16.out3)
end = Revit.Transaction.Transaction.End(input=addFilter)
new_schedule_as_active_view = Python(IN[0]=end)  # CPython3
# ---------- new_schedule_as_active_view.python (15 lines) ----------
import clr
clr.AddReference('RevitServices')
from RevitServices.Persistence import DocumentManager

clr.AddReference('RevitAPI')
clr.AddReference('RevitAPIUI')
from Autodesk.Revit.UI import UIDocument

doc = DocumentManager.Instance.CurrentDBDocument
uidoc = DocumentManager.Instance.CurrentUIApplication.ActiveUIDocument

scheduleView = UnwrapElement(IN[0])
uidoc.RequestViewChange(scheduleView)

OUT = scheduleView
# ----------------------------------------
code_block_17 = CodeBlock(schedules=new_schedule_as_active_view)
# ---------- code_block_17.designscript (4 lines) ----------
schedules;

setViewPurpose = Revit.Elements.Element.SetParameterByName(schedules, "View_Category", "Report Export");
setViewPackage = Revit.Elements.Element.SetParameterByName(schedules, "Sheet_Sub Category", "Mechanical - Missing IDs");
# ----------------------------------------

# group: COMPARE MECH SYSTEM NAMES VERSUS EXISTING DUCT SYSTEM NAMES
code_block_18 = CodeBlock { "Duct Systems"; }
byName_2 = Category.ByName(name=code_block_18)
all_elements_of_category_2 = ElementsOfCategory(Category=byName_2)
code_block_19 = CodeBlock(duct_system_elements=all_elements_of_category_2)
# ---------- code_block_19.designscript (2 lines) ----------
duct_system_elements;
duct_system_names = Revit.Elements.Element.GetParameterValueByName(duct_system_elements, "System Name");
# ----------------------------------------
code_block_20 = CodeBlock(validElements=code_block_8.out7)
# ---------- code_block_20.designscript (4 lines) ----------
validElements;

mechSystemNames = Revit.Elements.Element.GetParameterValueByName(validElements, "System Name");
splitNames = DSCore.String.Split(mechSystemNames, [","]);
# ----------------------------------------
code_block_21 = CodeBlock(duct_system_elements=code_block_19.duct_system_elements, duct_system_names=code_block_19.duct_system_names, mech_equipment_elements=code_block_20.validElements, mech_equipment_systems=code_block_20.splitNames) { duct_system_elements; duct_system_names; mech_equipment_elements; mech_equipment_systems; }
get_elements_with_valid_code_id_2 = Python(IN[0]=code_block_21.duct_system_elements, IN[1]=code_block_21.duct_system_names, IN[2]=code_block_21.mech_equipment_elements, IN[3]=code_block_21.mech_equipment_systems)  # CPython3
# ---------- get_elements_with_valid_code_id_2.python (33 lines) ----------
# Load the Python Standard and DesignScript Libraries
import sys
import clr
clr.AddReference('ProtoGeometry')
from Autodesk.DesignScript.Geometry import *

duct_system_elements  = IN[0]
duct_system_names  = IN[1]
mech_equipment_elements =IN[2]
mech_equipment_system_names =IN[3]

found_duct_systems = []
not_found_names = []
not_found_mech_equipments = []
indx_check = []

for name, element in zip(mech_equipment_system_names, mech_equipment_elements):
    found_sublist = []
    not_found_sublist = []
    for n in name:
        if n in duct_system_names:
            index = duct_system_names.index(n)
            indx_check.append(index)
            match_ele = duct_system_elements[index]
            found_sublist.append(match_ele)
        else:
            not_found_sublist.append(n)
            not_found_mech_equipments.append(element)
    found_duct_systems.append(found_sublist)
    not_found_names.append(not_found_sublist)


OUT = (found_duct_systems, not_found_names, set(not_found_mech_equipments), indx_check)
# ----------------------------------------

# group: GATE - EXPORT OUT ELEMENTS WITH NON-MATCHING SYSTEM NAMES
code_block_22 = CodeBlock(data=get_elements_with_valid_code_id_2, availableNames=code_block_19.duct_system_names) { data; availableNames; }
code_block_23 = CodeBlock(data=code_block_22.data, availableNames=code_block_22.availableNames)
# ---------- code_block_23.designscript (23 lines) ----------
data;
availableNames;

// get elements with nulls
elementsWithNulls = data[2];

// check element counts
isEmpty = List.IsEmpty(elementsWithNulls);
allowData = [Imperative]{
if (isEmpty == false)
	return elementsWithNulls;
else
	return List.Empty;
};

// get element system names
systemNames = Revit.Elements.Element.GetParameterValueByName(allowData, "System Name");
splitNames = DSCore.String.Split(systemNames, [","]);

//output
elementsWithNulls;
splitNames;
availableNames;
# ----------------------------------------
code_block_24 = CodeBlock(elements=code_block_23.out7, element_system_names=code_block_23.out8, available_names=code_block_23.out9) { elements; element_system_names; available_names; }
report_elements_with_none = Python(IN[0]=code_block_24.elements, IN[1]=code_block_24.element_system_names, IN[2]=code_block_24.available_names)  # "Report Elements with None Matching System Names"; CPython3
# ---------- report_elements_with_none.python (31 lines) ----------
# Load the Python Standard and DesignScript Libraries
import sys
import clr
clr.AddReference('ProtoGeometry')
from Autodesk.DesignScript.Geometry import *


elements = IN[0]
element_system_names = IN[1]
available_names = IN[2]

found_list = []
not_found_indx = []
not_found_list = []

for names, ele in zip(element_system_names, elements):
	found_sublist = []
	for name in names:
		if name in available_names:
			found_sublist.append(name)
	found_list.append(found_sublist)

for indx, l in enumerate(found_list):
    if l:
        continue
    not_found_indx.append(indx)
    
for indx in not_found_indx:
    not_found_list.append(elements[indx])

OUT = found_list, not_found_indx, not_found_list
# ----------------------------------------
code_block_25 = CodeBlock(data=report_elements_with_none)
# ---------- code_block_25.designscript (3 lines) ----------
elements = data[2];
elementIds = Revit.Elements.Element.Id(elements);
elementNames = Revit.Elements.Element.Name(elements);
# ----------------------------------------

# group: GET ALL ELEMENTS OF DUCT SYSTEM NETWORK
code_block_26 = CodeBlock(data=get_elements_with_valid_code_id_2)
# ---------- code_block_26.designscript (15 lines) ----------
data;

validElements = data[0];

// check element counts
isEmpty = List.IsEmpty(validElements);
allowData = [Imperative]{
if (isEmpty == false)
	return validElements;
else
	return List.Empty;
};

//output
allowData;
# ----------------------------------------
ductsystem_all_elements_in = Custom[DuctSystem all elements in network](DuctSystem=code_block_26.out4)  # package MEPover; Returns every element in the duct network, inlcuding ducts, fittings etc.
flatten = List.Flatten(list=ductsystem_all_elements_in@@L3)

# group: GENERATE 3D VIEWS FOR EACH MECHANICAL EQUIPMENTS, WITH ITS DUCT NETWORKS
code_block_27 = CodeBlock { "View3D"; }
byName_3 = Orchid.RevitProject.Elements.Class.ByName(name=code_block_27)
all_elements_of_class = ElementsOfType(element_class=byName_3)
code_block_28 = CodeBlock { false; }
clean = List.Clean(list=all_elements_of_class, preserveIndices=code_block_28)
code_block_29 = CodeBlock(sampleView=clean) { sampleView[0]; }
code_block_30 = CodeBlock(sampleView=code_block_29, validElements=code_block_8.out7)
# ---------- code_block_30.designscript (17 lines) ----------
sampleView;
validElements;

// check valid elements
isEmpty = List.IsEmpty(validElements);

// terminate view creationg
// if valid elements are empty
allowView = [Imperative]{
if (isEmpty == false)
	return sampleView;
else
	return List.Empty;
};

//output
allowView;
# ----------------------------------------
code_block_31 = CodeBlock(mechanicalEquipments=code_block_8.out7)
# ---------- code_block_31.designscript (10 lines) ----------
mechanicalEquipments;

// generate view names
equipmentName = Revit.Elements.Element.GetParameterValueByName(mechanicalEquipments, "Equipment Name");
equipmentCodeId = Revit.Elements.Element.GetParameterValueByName(mechanicalEquipments, "Equipment Code ID");
addPrefix = equipmentName + "-";
viewNames = addPrefix + equipmentCodeId;

// output
viewNames;
# ----------------------------------------
duplicate = Custom[View.Duplicate](view=code_block_30.out4, name=code_block_31.out5)  # package Clockwork for Dynamo 2.x; Duplicates a given view
end_2 = Revit.Transaction.Transaction.End(input=duplicate)
code_block_32 = CodeBlock(views=end_2)
# ---------- code_block_32.designscript (5 lines) ----------
views;

setViewPurpose = Revit.Elements.Element.SetParameterByName(views, "View Purpose", "99 - Report");
setViewPackage = Revit.Elements.Element.SetParameterByName(views, "Package", "Report - Mechanical");
setViewSubPackage = Revit.Elements.Element.SetParameterByName(views, "Sub-Package", "Mechanical Report");
# ----------------------------------------
watch_2 = Watch(code_block_30.out3)
watch_3 = Watch(code_block_30.out2)
isolateElementsTemporary = View.IsolateElementsTemporary(view=end_2, elements=flatten)
convertTemporaryHideIsolateToPermanent = Custom[View.ConvertTemporaryHideIsolateToPermanent](view=isolateElementsTemporary)  # package Clockwork for Dynamo 2.x; Convert all temporary hidden elements or categories to permanently hidden in the given view.

# group: SUCCESS MESSAGE #1
end_3 = Revit.Transaction.Transaction.End(input=convertTemporaryHideIsolateToPermanent.view)
code_block_33 = CodeBlock(views=end_3)
# ---------- code_block_33.designscript (15 lines) ----------
views;

//
isEmpty = List.IsEmpty(views);
viewCounts = List.Count(views);

allowMessage = [Imperative]{
if (isEmpty == false)
	return viewCounts + " new views are generated!";
else
	return List.Empty;
};

"Success!";
allowMessage;
# ----------------------------------------
ʳʰʸᵗʰᵐ_helpers_simpleusermessage_2 = Rhythm.Revit.Helpers.Helpers.SimpleUserMessage(caption=code_block_33.out4, message=code_block_33.out5)

# group: WARNING MESSAGE #1
list_create = List.Create(item0=code_block_25.elementIds, item1=code_block_25.elementNames)  # frozen
string_from_object_2 = FromObject(object=list_create)
code_block_34 = CodeBlock { ","; }  # frozen
string_from_object_3 = FromObject(object=code_block_25.elementIds)
join = String.Join(separator=code_block_34, string0=string_from_object_3)
code_block_35 = CodeBlock(data=join)
# ---------- code_block_35.designscript (20 lines) ----------
data;
caption = "Warning!";
message = "Mechanical equipments with no matching system names found!
Data is copied to clipboard!! Simply paste it on notepad!";

//
isEmpty = List.IsEmpty(data);

allowData = [Imperative]{
if (isEmpty == false)
	return [caption, message, data];
else
	return [List.Empty, List.Empty, List.Empty];
};



allowCaption = allowData[0];
allowMessage = allowData[1];
allowInfo = allowData[2];
# ----------------------------------------
ʳʰʸᵗʰᵐ_system_sendtoclipboard = Rhythm.Helpers.System.SendToClipboard(str=code_block_35.out7)
list_create_2 = List.Create(item0=code_block_35.out5, item1=code_block_35.out6)
await_ = Orchid.Common.DataStream.Await(pass=list_create_2, waitFor=code_block_33.out5)
code_block_36 = CodeBlock(data=await_) { data; caption = data[0]; message = data[1]; }
ʳʰʸᵗʰᵐ_helpers_simpleusermessage_3 = Rhythm.Revit.Helpers.Helpers.SimpleUserMessage(caption=code_block_36.caption, message=code_block_36.message)

# group: ISOLATE MECHANICAL EQUIPMENTS WITH ISSUES
code_block_37 = CodeBlock(sampleView=code_block_30.out4) { sampleView; "Equipments with errors"; }
duplicate_2 = Custom[View.Duplicate](view=code_block_37.sampleView, name=code_block_37.out1)
isolateElementsTemporary_2 = View.IsolateElementsTemporary(view=duplicate_2, elements=code_block_25.elements)
convertTemporaryHideIsolateToPermanent_2 = Custom[View.ConvertTemporaryHideIsolateToPermanent](view=isolateElementsTemporary_2)
end_4 = Revit.Transaction.Transaction.End(input=convertTemporaryHideIsolateToPermanent_2.view)
new_schedule_as_active_view_2 = Python(IN[0]=end_4)  # CPython3; same code as new_schedule_as_active_view
code_block_38 = CodeBlock(views=duplicate_2)
# ---------- code_block_38.designscript (5 lines) ----------
views;

setViewPurpose = Revit.Elements.Element.SetParameterByName(views, "View Purpose", "99 - Report");
setViewPackage = Revit.Elements.Element.SetParameterByName(views, "Package", "Report - Mechanical");
setViewSubPackage = Revit.Elements.Element.SetParameterByName(views, "Sub-Package", "Error Schedules");
# ----------------------------------------
