# Dynamo graph 02. Generate 3D View by Selected Equipment and Systems_script.dyn (Dynamo 2.19.3.6394)
# packages: Data-Shapes 2024.2.114, Orchid 2.19.3.6373, MEPover 2024.9.25, Rhythm 2024.10.1, Clockwork for Dynamo 2.x 2.12.2

# group: SCRIPT INFORMATION
code_block = CodeBlock()
# ---------- code_block.designscript (19 lines) ----------
//-----------SCRIPT INFORMATION-----------//
/*
Version: 1.0.0
Script Name: Generate System 3D View
Developed by: AECOM MY - Amer Nasir, Tuah Hamid
Date: 06/03/2025

Version: 1.1.0
Date: 11/03/2025
Change log:
- Filter elements based on Mechanical Equipment first
- Allow main system selection, plus, additional systems to add

Version: 1.1.1
Date: 21/04/2025
Change log:
- Removed FCU from valid system names
- Brute include mech equipment in elements to be isolated
*/;
# ----------------------------------------
code_block_2 = CodeBlock()
# ---------- code_block_2.designscript (9 lines) ----------
//-----------DEPENDENCIES-----------//
/*
Data-Shapes 2025.3.118
Genius Loci 2024.2.114
Orchid 2.19.3.6373
Clockwork 2.12.2
MEPover 2024.9.25
DynamoIronPython2.7	2.4.0
*/;
# ----------------------------------------

# group: GET MECH EQUIPMENT ELEMENTS
code_block_3 = CodeBlock { "Mechanical Equipment"; }
byName = Category.ByName(name=code_block_3)
all_elements_of_category = ElementsOfCategory(Category=byName)

# group: UI - SELECT EQUIPMENT NAME
code_block_4 = CodeBlock()
# ---------- code_block_4.designscript (9 lines) ----------
[
"AHU",
"OAU",
"EAF",
"FAF",
"SEF",
"GPF",
"SPF"
];
# ----------------------------------------
code_block_5 = CodeBlock(keys=code_block_4, values=code_block_4) { "Select equipment name"; keys; values; 0; }
radiobuttons_data = Custom[RadioButtons Data](InputName=code_block_5.out0, Keys=code_block_5.keys, Values=code_block_5.values, DefaultValueIndex=code_block_5.out3)  # package Data-Shapes; Create radio buttons input for UI.MultipleInputForm ++ .
code_block_6 = CodeBlock()
# ---------- code_block_6.designscript (3 lines) ----------
"Script Information";
"Developed by: AECOM MY
Version: 1.1.1";
# ----------------------------------------
textnote_data = Custom[TextNote Data](Title=code_block_6.out0, TextNote=code_block_6.out1)  # package Data-Shapes; Create Data for TextNote input in UI.MultipleInputForm ++ . Check out www.data-shapes.net for more informations
list_create = List.Create(item0=radiobuttons_data, item1=textnote_data)
code_block_7 = CodeBlock(inputs=list_create) { "Generate 3D view by Equipment"; "Logo"; "Select"; inputs; true; "Cancel"; 1500; 550; 175; }
multipleinputform = Custom[MultipleInputForm ++](Description_optional=code_block_7.out0, Logo_optional=code_block_7.out1, ButtonText_optional=code_block_7.out2, Inputs=code_block_7.inputs, Toggle=code_block_7.out4, CancelButtonText_optional=code_block_7.out5, MaxHeight_optional=code_block_7.out6, Width_optional=code_block_7.out7, LabelWidth_optional=code_block_7.out8)  # package Data-Shapes; Create a form with multiple inputs. see www.data-shapes.net for tutorials and infos!

# group: DATA GATE
code_block_8 = CodeBlock(input=multipleinputform.User_Inputs, wasRun=multipleinputform.Was_Run, wasCancelled=multipleinputform.Was_Cancelled)
# ---------- code_block_8.designscript (17 lines) ----------
input;
wasRun;
wasCancelled;

isEmpty = List.IsEmpty(input);
checkNulls = input == null;
isNull = List.AnyTrue(checkNulls);

allowData = [Imperative]{
if (wasRun == true && wasCancelled == false && isEmpty == false && isNull == false)
	return input;
else
	return List.Empty;
};

//output
allowData;
# ----------------------------------------

# group: GET VALID MECH EQUIPMENTS
code_block_9 = CodeBlock(allMechEquipments=all_elements_of_category, input=code_block_8.out7)
# ---------- code_block_9.designscript (13 lines) ----------
allMechEquipments;
input;

//get valid equipments
eqNames = Revit.Elements.Element.GetParameterValueByName(allMechEquipments, "Equipment Name");
isValidName = DSCore.String.Contains(eqNames<1L>, input<1L>, false);
count = List.Count(allMechEquipments);
indX = isValidName==true?-1:0..count-1;
validMechEquipments = List.RemoveItemAtIndex(allMechEquipments, indX);

//output
validMechEquipments;
eqCode = input;
# ----------------------------------------

# group: GET COMBINED EQUIPMENT CODES
code_block_10 = CodeBlock(validMechEquipments=code_block_9.out7, eqCode=code_block_9.out8)
# ---------- code_block_10.designscript (13 lines) ----------
validMechEquipments;
eqCode;

//get equipment code Id
eqCodeId = Revit.Elements.Element.GetParameterValueByName(validMechEquipments, "Equipment Code ID");
sorted_dict = List.SortByKey(validMechEquipments, eqCodeId);
sorted_ids = Dictionary.ValueAtKey(sorted_dict, "sortedKeys");
sorted_equipments = Dictionary.ValueAtKey(sorted_dict, "sortedList");
combEqCode = List.Flatten(eqCode + "-" + sorted_ids<1L>, -1);

//output
combEqCode;
sorted_equipments;
# ----------------------------------------

# group: GET DUCT SYSTEM ELEMENTS
code_block_11 = CodeBlock { "Duct Systems"; }
byName_2 = Category.ByName(name=code_block_11)
all_elements_of_category_2 = ElementsOfCategory(Category=byName_2)
code_block_12 = CodeBlock { "System Name"; }
getParameterValueByName = Element.GetParameterValueByName(element=all_elements_of_category_2, parameterName=code_block_12)
sortNatural = Orchid.Common.List.SortNatural(list=getParameterValueByName)
sortGroupByKey = Orchid.Common.List.SortGroupByKey(list=all_elements_of_category_2, keys=getParameterValueByName, sortedKeys=sortNatural)
flatten = List.Flatten(list=sortGroupByKey.groups)

# group: UI - SELECT SYSTEM NAMES
code_block_13 = CodeBlock(keys=code_block_10.out7, values=code_block_10.out8) { "Select Equipment No."; keys; values; 0; false; }
dropdown_data = Custom[DropDown Data](InputName=code_block_13.out0, Keys=code_block_13.keys, Values=code_block_13.values, DefaultValueIndex=code_block_13.out3, Sorted_optional=code_block_13.out4)  # package Data-Shapes; Create data for DropDown input in UI.MultiInputForm ++ . Check out www.data-shapes.net for more infos.
code_block_14 = CodeBlock(keys=sortGroupByKey.unique_keys, values=flatten) { "Select additional System (if any)"; keys; values; true; false; false; }
listview_data = Custom[Listview Data](InputName=code_block_14.out0, Keys=code_block_14.keys, Values=code_block_14.values, ShowElementCount_optionnal=code_block_14.out3, SortItems_optionnal=code_block_14.out4, ShowId_optionnal=code_block_14.out5)  # package Data-Shapes; Create data for ListView input in UI.MultiInputForm ++ . Check out www.data-shapes.net for more infos.
code_block_15 = CodeBlock()
# ---------- code_block_15.designscript (3 lines) ----------
"Script Information";
"Developed by: AECOM MY
Version: 1.1.0";
# ----------------------------------------
textnote_data_2 = Custom[TextNote Data](Title=code_block_15.out0, TextNote=code_block_15.out1)
list_create_2 = List.Create(item0=dropdown_data, item1=listview_data, item2=textnote_data_2)
code_block_16 = CodeBlock(inputs=list_create_2) { "Generate 3D view by Equipment"; "Logo"; "Select"; inputs; true; "Cancel"; 1500; 550; 245; }
multipleinputform_2 = Custom[MultipleInputForm ++](Description_optional=code_block_16.out0, Logo_optional=code_block_16.out1, ButtonText_optional=code_block_16.out2, Inputs=code_block_16.inputs, Toggle=code_block_16.out4, CancelButtonText_optional=code_block_16.out5, MaxHeight_optional=code_block_16.out6, Width_optional=code_block_16.out7, LabelWidth_optional=code_block_16.out8)

# group: DATA GATE
code_block_17 = CodeBlock(input=multipleinputform_2.User_Inputs, wasRun=multipleinputform_2.Was_Run, wasCancelled=multipleinputform_2.Was_Cancelled)  # same code as code_block_8

# group: GENERATE SYSTEM NAME DATA
code_block_18 = CodeBlock(data=code_block_17.out7)
# ---------- code_block_18.designscript (18 lines) ----------
data;

equipment = data[0];
ductSystems = data[1];

// duct system names
ductSystemNames = Revit.Elements.Element.GetParameterValueByName(ductSystems, "System Name");

// get system names from mech equipment
mechSystemNames = Revit.Elements.Element.GetParameterValueByName(equipment, "System Name");
mechSystemNamesList = DSCore.String.Split(mechSystemNames, [","]);

// join duct and mech system names
allSystemNames = List.Join([ductSystemNames, mechSystemNamesList]);

//output
equipment;
allSystemNames;
# ----------------------------------------

# group: GENERATE 3D VIEWS AND ITS PROPERTIES
code_block_19 = CodeBlock { "View3D"; }
byName_3 = Orchid.RevitProject.Elements.Class.ByName(name=code_block_19)
all_elements_of_class = ElementsOfType(element_class=byName_3)
code_block_20 = CodeBlock { false; }
clean = List.Clean(list=all_elements_of_class, preserveIndices=code_block_20)
name = Element.Name(element=clean)
code_block_21 = CodeBlock(sampleView=clean) { sampleView[0]; }
code_block_22 = CodeBlock(existingViewNames=name, viewName=code_block_21) { existingViewNames; viewName; }
code_block_23 = CodeBlock(equipment=code_block_18.out7)
# ---------- code_block_23.designscript (9 lines) ----------
equipment;

codeId = Revit.Elements.Element.GetParameterValueByName(equipment, "Equipment Code ID");
eqName = Revit.Elements.Element.GetParameterValueByName(equipment, "Equipment Name");
viewName = eqName + "-" + codeId;

//output
viewName;
equipment;
# ----------------------------------------
compare_existing_views = Python(IN[0]=code_block_22.existingViewNames, IN[1]=code_block_22.viewName, IN[2]=code_block_23.out4)  # CPython3
# ---------- compare_existing_views.python (18 lines) ----------
# Load the Python Standard and DesignScript Libraries
import sys
import clr
clr.AddReference('ProtoGeometry')
from Autodesk.DesignScript.Geometry import *

existingViewNames = IN[0]
viewName = IN[2]
view = IN[1]

isValid = None

if viewName in existingViewNames:
    isValid = False
else:
    isValid = True

OUT = isValid, viewName, view
# ----------------------------------------
code_block_24 = CodeBlock(sampleEquipmentCode=code_block_23.out1) { sampleEquipmentCode; }

# group: DATA GATE - TERMINATE IF VIEW NAME ALREADY EXISTS
code_block_25 = CodeBlock(allowData=compare_existing_views)
# ---------- code_block_25.designscript (20 lines) ----------
allowData;

//isEmpty
isEmpty = List.IsEmpty(allowData);

allowErrorMessage = [Imperative]{
if (allowData[0] == false)
	return ["View " + allowData[1] + " already exist in project!",
	List.Empty,
	List.Empty
	];
else
	return [List.Empty, allowData[2], allowData[1]];
}

caption = "Warning!";
message = allowErrorMessage[0];

sampleView = allowErrorMessage[1];
viewName = allowErrorMessage[2];
# ----------------------------------------
duplicate = Custom[View.Duplicate](view=code_block_25.out5, name=code_block_25.out6)  # package Clockwork for Dynamo 2.x; Duplicates a given view
ʳʰʸᵗʰᵐ_helpers_simpleusermessage = Rhythm.Revit.Helpers.Helpers.SimpleUserMessage(caption=code_block_25.out3, message=code_block_25.out4)

# group: GET CONNECTED ELEMENTS OF SELECTED SYSTEMS
code_block_26 = CodeBlock(allDuctSystems=all_elements_of_category_2) { allDuctSystems; allDuctSystemNames = Revit.Elements.Element.GetParameterValueByName(allDuctSystems, "System Name"); }
get_valid_duct_system = Python(IN[0]=code_block_18.out8, IN[1]=code_block_26.allDuctSystems, IN[2]=code_block_26.allDuctSystemNames)  # CPython3
# ---------- get_valid_duct_system.python (20 lines) ----------
# Load the Python Standard and DesignScript Libraries
import sys
import clr
clr.AddReference('ProtoGeometry')
from Autodesk.DesignScript.Geometry import *

all_duct_system_names = IN[0]
all_systems = IN[1]
all_system_names = IN[2]

valid_system = []
names = []

for name, system in zip(all_system_names, all_systems):
    if name in all_duct_system_names:
        names.append(name)
        valid_system.append(system)


OUT = names, valid_system
# ----------------------------------------
code_block_27 = CodeBlock(a=get_valid_duct_system) { a[1]; }
ductsystem_all_elements_in = Custom[DuctSystem all elements in network](DuctSystem=code_block_27)  # package MEPover; Returns every element in the duct network, inlcuding ducts, fittings etc.
flatten_2 = List.Flatten(list=ductsystem_all_elements_in)

# group: INCLUDE MECH EQUIPMENTS
# This is for scenarios where selected systems do not connect with the selected equipment
list_create_3 = List.Create(item0=code_block_23.out5, item1=flatten_2)
flatten_3 = List.Flatten(list=list_create_3)

# group: ISOLATE ELEMENTS IN VIEW AND SUCCESS MESSAGE
isolateElementsTemporary = View.IsolateElementsTemporary(view=duplicate, elements=flatten_3)
convertTemporaryHideIsolateToPermanent = Custom[View.ConvertTemporaryHideIsolateToPermanent](view=isolateElementsTemporary)  # package Clockwork for Dynamo 2.x; Convert all temporary hidden elements or categories to permanently hidden in the given view.
end = Revit.Transaction.Transaction.End(input=convertTemporaryHideIsolateToPermanent.view)
code_block_28 = CodeBlock(views=end)
# ---------- code_block_28.designscript (14 lines) ----------
views;

//is empty
isEmpty = List.IsEmpty(views);

allowMessage = [Imperative]{
if (isEmpty == true || views == null)
	return List.Empty;
else
	return "Transaction complete!";
};

caption = "Result!";
allowMessage;
# ----------------------------------------
ʳʰʸᵗʰᵐ_helpers_simpleusermessage_2 = Rhythm.Revit.Helpers.Helpers.SimpleUserMessage(caption=code_block_28.out3, message=code_block_28.out4)
watch = Watch(code_block_28.out2)
watch_2 = Watch(code_block_28.out1)
set_view_as_active = Python(IN[0]=end)  # CPython3
# ---------- set_view_as_active.python (15 lines) ----------
import clr
clr.AddReference('RevitServices')
from RevitServices.Persistence import DocumentManager

clr.AddReference('RevitAPI')
clr.AddReference('RevitAPIUI')
from Autodesk.Revit.UI import UIDocument

doc = DocumentManager.Instance.CurrentDBDocument
uidoc = DocumentManager.Instance.CurrentUIApplication.ActiveUIDocument

scheduleView = UnwrapElement(IN[0])
uidoc.RequestViewChange(scheduleView)

OUT = scheduleView
# ----------------------------------------

# group: SET PROJECT BROWSER HIERARCHY
code_block_29 = CodeBlock(view=duplicate)
# ---------- code_block_29.designscript (5 lines) ----------
view;

setFolderPuporse = Revit.Elements.Element.SetParameterByName(view, "View Purpose", "99 - Report");
setServiceType = Revit.Elements.Element.SetParameterByName(view, "Package", "Report - Mechanical");
setDrawingType = Revit.Elements.Element.SetParameterByName(view, "Sub-Package", "Mechanical Report");
# ----------------------------------------
