# Dynamo graph 03. Id by DFS_script.dyn (Dynamo 2.19.3.6394)
# packages: Data-Shapes 2024.2.114

# group: SELECTION UI
code_block = CodeBlock()
# ---------- code_block.designscript (6 lines) ----------
cats = [
Revit.Category.ByName("Ducts"),
Revit.Category.ByName("Duct Fittings"),
Revit.Category.ByName("Mechanical Equipment"),
Revit.Category.ByName("Air Terminals")
];
# ----------------------------------------
code_block_2 = CodeBlock(categories=code_block) { "Select first element"; "Select"; categories; true; }
selectmodelelements_data = Custom[SelectModelElements Data](InputName=code_block_2.out0, ButtonText=code_block_2.out1, CategoryFilter=code_block_2.categories, SelectSingleElement=code_block_2.out3)  # package Data-Shapes; Creates a Revit element selection input for UI.MultipleInputForm++ . Check out www.data-shapes.net for more infos!
code_block_3 = CodeBlock(inputs=selectmodelelements_data) { "First selection"; inputs; }
inputgroup_data = Custom[InputGroup Data](GroupTitle=code_block_3.out0, Inputs=code_block_3.inputs)  # package Data-Shapes; Creates a group of inputs for UI.MultipleInputForm ++ . Check out www.data-shapes.net for more infos !
code_block_4 = CodeBlock()  # same code as code_block
code_block_5 = CodeBlock(categories=code_block_4) { "Select last element"; "Select"; categories; true; }
selectmodelelements_data_2 = Custom[SelectModelElements Data](InputName=code_block_5.out0, ButtonText=code_block_5.out1, CategoryFilter=code_block_5.categories, SelectSingleElement=code_block_5.out3)
code_block_6 = CodeBlock(inputs=selectmodelelements_data_2) { "Last selection"; inputs; }
inputgroup_data_2 = Custom[InputGroup Data](GroupTitle=code_block_6.out0, Inputs=code_block_6.inputs)
code_block_7 = CodeBlock { "Starting number"; "1"; true; }
textbox_data = Custom[TextBox Data](InputName=code_block_7.out0, DefaultText=code_block_7.out1, IsNumberEntry=code_block_7.out2)  # package Data-Shapes; Create Data for TextBox input in UI.MultipleInputForm ++ . Check out www.data-shapes.net for more informations
code_block_8 = CodeBlock(inputs=textbox_data) { "Sequence preference"; inputs; }
inputgroup_data_3 = Custom[InputGroup Data](GroupTitle=code_block_8.out0, Inputs=code_block_8.inputs)
code_block_9 = CodeBlock()
# ---------- code_block_9.designscript (3 lines) ----------
"Script Information";
"Developed by: AECOM MY
Version: 1.0.1";
# ----------------------------------------
textnote_data = Custom[TextNote Data](Title=code_block_9.out0, TextNote=code_block_9.out1)  # package Data-Shapes; Create Data for TextNote input in UI.MultipleInputForm ++ . Check out www.data-shapes.net for more informations
list_create = List.Create(item0=inputgroup_data, item1=inputgroup_data_2, item2=inputgroup_data_3, item3=textnote_data)
boolean = BoolSelector(true)
code_block_10 = CodeBlock(inputs=list_create, toggle=boolean) { "Assign Id No"; "Logo"; "Accept"; inputs; toggle; "Cancel"; 800; 600; 200; }
multipleinputform = Custom[MultipleInputForm ++](Description_optional=code_block_10.out0, Logo_optional=code_block_10.out1, ButtonText_optional=code_block_10.out2, Inputs=code_block_10.inputs, Toggle=code_block_10.toggle, CancelButtonText_optional=code_block_10.out5, MaxHeight_optional=code_block_10.out6, Width_optional=code_block_10.out7, LabelWidth_optional=code_block_10.out8)  # package Data-Shapes; Create a form with multiple inputs. see www.data-shapes.net for tutorials and infos!
code_block_11 = CodeBlock(input=multipleinputform.User_Inputs, wasRun=multipleinputform.Was_Run, wasCancelled=multipleinputform.Was_Cancelled)
# ---------- code_block_11.designscript (17 lines) ----------
input;
wasRun;
wasCancelled;

isEmpty = List.IsEmpty(input);
checkNulls = input == null;
isNull = List.AnyTrue(checkNulls);

allowData = [Imperative]{
if (wasRun == true && wasCancelled == false && isEmpty == false && isNull == false)
	return input;
else
	return List.Empty;
};

//output
allowData;
# ----------------------------------------

# group: PATH SEARCH ALGO
code_block_12 = CodeBlock(data=code_block_11.out7) { start = data[0]; end = data[1]; startNumber = data[2]; }
r_v2 = Python(IN[0]=code_block_12.start, IN[1]=code_block_12.end)  # CPython3
# ---------- r_v2.python (45 lines) ----------
#Preparing input from dynamo to revit
start = UnwrapElement(IN[0])
end = UnwrapElement(IN[1])
  
    
def get_connected_elements(element):
    try:
        connectors = element.ConnectorManager.Connectors
    except:
        connectors = element.MEPModel.ConnectorManager.Connectors

    connected_elements = []
    for connector in connectors:
        for connected_connector in connector.AllRefs:
            connected_element = connected_connector.Owner
            if connected_element.Id != element.Id and "System" not in connected_element.Category.Name:
                connected_elements.append(connected_element)
    return connected_elements


def find_path(start_duct, end_duct, visited=None, path=None):
    if visited is None:
        visited = set()
    if path is None:
        path = []

    visited.add(start_duct.Id)
    path.append(start_duct)

    if start_duct.Id == end_duct.Id:
        return path

    connected_elements = get_connected_elements(start_duct)
    
    for element in connected_elements:
        if element.Id not in visited:
            result = find_path(element, end_duct, visited, path)
            if result:
                return result

    path.pop()
    return None


OUT = find_path(start, end)
# ----------------------------------------
code_block_13 = CodeBlock(startNumber=code_block_12.startNumber, elements=r_v2) { startNumber; List.Count(elements); 1; }
sequence = Sequence(start=code_block_13.startNumber, amount=code_block_13.out1, step=code_block_13.out2)
code_block_14 = CodeBlock { "Type"; }
getParameterValueByName = Element.GetParameterValueByName(element=r_v2, parameterName=code_block_14)

# group: ISOLATE SELECTED ELEMENT
current = Document.Current()
activeView = Document.ActiveView(document=current)
isolateElementsTemporary = View.IsolateElementsTemporary(view=activeView, elements=r_v2)

# group: SET PARAMETER VALUES
code_block_15 = CodeBlock { "id no"; }
string_from_object = FromObject(object=sequence)
code_block_16 = CodeBlock { "."; }
split = String.Split(string=string_from_object, separator0=code_block_16)
code_block_17 = CodeBlock { 0; }
getItemAtIndex = List.GetItemAtIndex(list=split@L2, index=code_block_17)
setParameterByName = Element.SetParameterByName(element=r_v2, parameterName=code_block_15, value=getItemAtIndex)

# group: SCRIPT INFORMATION
code_block_18 = CodeBlock()
# ---------- code_block_18.designscript (12 lines) ----------
//-----------SCRIPT INFORMATION-----------//
/*
Version: 1.0.0
Script Name: Generate Id Number for Mech Routing
Developed by: AECOM MY - Amer Nasir, Tuah Hamid
Date: 17/03/2025

Version: 1.0.1
Date: 17/03/2025
Change log:
Allow starting number input instead of default 0
*/;
# ----------------------------------------
code_block_19 = CodeBlock()
# ---------- code_block_19.designscript (10 lines) ----------
//-----------DEPENDENCIES-----------//
/*
Data-Shapes            || 2025.3.118
Genius Loci            || 2024.2.114
Orchid                 || 2.19.3.6373
Clockwork              || 2.12.2
MEPover                || 2024.9.25
DynamoIronPython2.7	   || 2.4.0
Rhythm                 || 2024.10.1
*/;
# ----------------------------------------
