# Dynamo graph 04. Convert TakeOff to Tee_script.dyn "Convert TakeOff to Tee" (Dynamo 2.19.3.6394)
# packages: MEPover 2024.9.25, Data-Shapes 2024.2.114

# group: SELECTION UI
code_block = CodeBlock { "Select Duct"; "Select"; Revit.Category.ByName("Ducts"); true; }
selectmodelelements_data = Custom[SelectModelElements Data](InputName=code_block.out0, ButtonText=code_block.out1, CategoryFilter=code_block.out2, SelectSingleElement=code_block.out3)  # package Data-Shapes; Creates a Revit element selection input for UI.MultipleInputForm++ . Check out www.data-shapes.net for more infos!
code_block_2 = CodeBlock(inputs=selectmodelelements_data) { "Select Main Duct"; inputs; }
inputgroup_data = Custom[InputGroup Data](GroupTitle=code_block_2.out0, Inputs=code_block_2.inputs)  # package Data-Shapes; Creates a group of inputs for UI.MultipleInputForm ++ . Check out www.data-shapes.net for more infos !
categories = Categories("OST_DuctFitting")
all_elements_of_category = ElementsOfCategory(Category=categories)
getFamily = FamilyInstance.GetFamily(familyInstance=all_elements_of_category)
uniqueItems = List.UniqueItems(list=getFamily)
code_block_3 = CodeBlock { "Part Type"; "tap"; true; }
parameterByName = Parameter.ParameterByName(element=uniqueItems, name=code_block_3.out0)
string_from_object = FromObject(object=parameterByName)
contains = String.Contains(string=string_from_object, searchFor=code_block_3.out1, ignoreCase=code_block_3.out2)
filterByBoolMask = List.FilterByBoolMask(list=uniqueItems, mask=contains)
code_block_4 = CodeBlock(inputs=filterByBoolMask.in) { "Select Type"; inputs; 0; }
dropdown_data = Custom[DropDown Data](InputName=code_block_4.out0, Keys=code_block_4.inputs, Values=code_block_4.inputs, DefaultValueIndex=code_block_4.out2)  # package Data-Shapes; Create data for DropDown input in UI.MultiInputForm ++ . Check out www.data-shapes.net for more infos.
code_block_5 = CodeBlock(inputs=dropdown_data) { "Select Take Off Type"; inputs; }
inputgroup_data_2 = Custom[InputGroup Data](GroupTitle=code_block_5.out0, Inputs=code_block_5.inputs)
list_create = List.Create(item0=inputgroup_data, item1=inputgroup_data_2)
boolean = BoolSelector(true)
code_block_6 = CodeBlock(inputs=list_create, toggle=boolean) { "Convert Take Off to Tee"; "Logo"; "Accept"; inputs; toggle; "Cancel"; 600; 600; 200; }
multipleinputform = Custom[MultipleInputForm ++](Description_optional=code_block_6.out0, Logo_optional=code_block_6.out1, ButtonText_optional=code_block_6.out2, Inputs=code_block_6.inputs, Toggle=code_block_6.toggle, CancelButtonText_optional=code_block_6.out5, MaxHeight_optional=code_block_6.out6, Width_optional=code_block_6.out7, LabelWidth_optional=code_block_6.out8)  # package Data-Shapes; Create a form with multiple inputs. see www.data-shapes.net for tutorials and infos!
code_block_7 = CodeBlock(input=multipleinputform.User_Inputs, wasRun=multipleinputform.Was_Run, wasCancelled=multipleinputform.Was_Cancelled)
# ---------- code_block_7.designscript (17 lines) ----------
input;
wasRun;
wasCancelled;

isEmpty = List.IsEmpty(input);
checkNulls = input == null;
isNull = List.AnyTrue(checkNulls);

allowData = [Imperative]{
if (wasRun == true && wasCancelled == false && isEmpty == false && isNull == false)
	return input;
else
	return List.Empty;
};

//output
allowData;
# ----------------------------------------

code_block_8 = CodeBlock(inputs=code_block_7.out7) { Main_duct = inputs[0]; Branch_duct = inputs[1]; }

# group: GET ALL TAKE OFF ELEMENTS
mep_connector_info = Custom[MEP Connector info+](element=code_block_8.Main_duct)  # package MEPover; This node will return the connectors and a lot of information about those connectors of the input elements
watch = Watch(mep_connector_info.ConnectedElements)
elementType = Element.ElementType(element=watch)
family_types_of_family = Custom[Family types of family](family=code_block_8.Branch_duct)  # package MEPover; Returns every family type of the given Family
equals = List.Equals(object=elementType@L1, otherObject=family_types_of_family, lacing=Longest)
filterByBoolMask_2 = List.FilterByBoolMask(list=watch, mask=equals)
watch_2 = Watch(filterByBoolMask_2.in)
flatten = List.Flatten(list=watch_2)
uniqueItems_2 = List.UniqueItems(list=flatten)

# group: GET MAIN DUCT AND BRANCH DUCT ELEMENTS
mep_connector_info_2 = Custom[MEP Connector info+](element=uniqueItems_2)
watch_3 = Watch(mep_connector_info_2.ConnectedElements)
getCategory = Element.GetCategory(element=watch_3)
categories_2 = Categories("OST_DuctCurves")
equals_2 = List.Equals(object=getCategory@@L1, otherObject=categories_2)
filterByBoolMask_3 = List.FilterByBoolMask(list=watch_3, mask=equals_2)
code_block_9 = CodeBlock(inputs=code_block_7.out7) { Main_duct = inputs[0]; Branch_duct = inputs[1]; }
equals_3 = List.Equals(object=code_block_9.Main_duct, otherObject=filterByBoolMask_3.in@@L1)
filterByBoolMask_4 = List.FilterByBoolMask(list=filterByBoolMask_3.in, mask=equals_3)
flatten_2 = List.Flatten(list=filterByBoolMask_4.in)
flatten_3 = List.Flatten(list=filterByBoolMask_4.out)

# group: REPLACE TAKE OFF WITH TEE
code_block_10 = CodeBlock(Tapoff=uniqueItems_2, Main_Ducting=flatten_2, Branch_Ducting=flatten_3) { Tapoff; Main_Ducting; Branch_Ducting; }
delete = Element.Delete(element=code_block_10.Tapoff)
end = Revit.Transaction.Transaction.End(input=delete)
code_block_11 = CodeBlock(Tapoff=end, Main_Ducting=code_block_10.Main_Ducting, Branch_Ducting=code_block_10.Branch_Ducting) { Tapoff; Main_Ducting; Branch_Ducting; }
by2MEPCurves = Custom[Tee.By2MEPCurves](Main_MEPCurve=code_block_11.Main_Ducting, Branch_MEPCurve=code_block_11.Branch_Ducting)  # package MEPover; Creates a tee by a main curve and a branch MEP curve (duct, pipe, conduit, cable tray). Only works with perpendicular brand curves

watch_4 = Watch(code_block_10.Main_Ducting)
watch_5 = Watch(code_block_10.Branch_Ducting)
watch_6 = Watch(code_block_11.Main_Ducting)
watch_7 = Watch(code_block_11.Branch_Ducting)
