# Dynamo graph BoxSleeveBottom_script.dyn (Dynamo 2.12.0.5650)
# packages: Rhythm 2022.11.4

code_block = CodeBlock { "Mechanical Equipment"; }
byName = Category.ByName(name=code_block)
all_elements_of_category = ElementsOfCategory(Category=byName)
name = Element.Name(element=all_elements_of_category)
code_block_2 = CodeBlock { "WOP"; }
eq = name == code_block_2
filterByBoolMask = List.FilterByBoolMask(list=all_elements_of_category, mask=eq)
geometry = Element.Geometry(element=filterByBoolMask.in)
watch = Watch(geometry)
code_block_3 = CodeBlock()
# ---------- code_block_3.designscript (3 lines) ----------
def SuccessMessage(counts){
return counts + " WOP elements updated.";
};
# ----------------------------------------
code_block_4 = CodeBlock(finalElements=filterByBoolMask.in) { finalElements; }
startPoint = Curve.StartPoint(curve=geometry)
Z = Point.Z(point=startPoint)
floor = Math.Floor(number=Z)
uniqueItems = List.UniqueItems(list=floor@L2)
sort = List.Sort(list=uniqueItems@L2)
code_block_5 = CodeBlock { 0; }
getItemAtIndex = List.GetItemAtIndex(list=sort@L2, index=code_block_5)
code_block_6 = CodeBlock(elements=code_block_4, zValues=getItemAtIndex)
# ---------- code_block_6.designscript (18 lines) ----------
elements;
zValues;

countEle = List.Count(elements);
countZ = List.Count(zValues);

test = countEle == countZ;

allowData = [Imperative]{

if (test == true)
	return [elements, zValues];
else
	return [List.Empty, List.Empty];
};

allowElements = allowData[0];
allowZ = allowData[1];
# ----------------------------------------
code_block_7 = CodeBlock(elements=code_block_6.out6, values=code_block_6.out7) { elements; "ACM_SOD_Bottom Of Equipment"; values; }
setParameterByName = Element.SetParameterByName(element=code_block_7.elements, parameterName=code_block_7.out1, value=code_block_7.values)
end = Revit.Transaction.Transaction.End(input=setParameterByName)
code_block_8 = CodeBlock(elements=end)
# ---------- code_block_8.designscript (14 lines) ----------
elements;

//is empty

isEmpty = List.IsEmpty(elements);
counts = List.Count(elements);

caption = "Results!";
allowMessage = [Imperative]{
if (isEmpty == false)
	return SuccessMessage(counts);
else
	return List.Empty;
};
# ----------------------------------------
ʳʰʸᵗʰᵐ_helpers_simpleusermessage = Rhythm.Revit.Helpers.Helpers.SimpleUserMessage(caption=code_block_8.out3, message=code_block_8.out4)
