# Dynamo graph PipeSleeveBottom_script.dyn (Dynamo 2.12.0.5650)
# packages: Rhythm 2022.11.4

code_block = CodeBlock()
# ---------- code_block.designscript (3 lines) ----------
def SuccessMessage(counts){
return counts + " pipe sleeve elements updated.";
};
# ----------------------------------------
code_block_2 = CodeBlock { famTypeName = "Wall Sleeve Steel Pipe Sch10"; }
byName = Family.ByName(name=code_block_2)
types = Family.Types(family=byName)
all_elements_of_family_type = ElementsOfFamilyType(Family_Type=types)
code_block_3 = CodeBlock(elements=all_elements_of_family_type)
# ---------- code_block_3.designscript (17 lines) ----------
elements;

//get elevation referenced to datum
elementLevels = Revit.Elements.Element.GetParameterValueByName(elements, "Level");
elevFromDatum = Revit.Level.Elevation(elementLevels);

//get elevation referenced to level
elevFromLevel = DSCore.Math.Round(Revit.Elements.Element.GetParameterValueByName(elements, "Elevation from Level"), 2);

//get outside diameter
outsideParameter = Revit.Elements.Element.GetParameterValueByName(elements, "DI");

//output
elements;
elevFromDatum;
elevFromLevel;
outsideParameter;
# ----------------------------------------
code_block_4 = CodeBlock(elements=code_block_3.out5, elevFromDatum=code_block_3.out6, elevFromLevel=code_block_3.out7, outsideParameter=code_block_3.out8)
# ---------- code_block_4.designscript (10 lines) ----------
elements;
elevFromDatum;
elevFromLevel;
outsideParameter;

bottomValues = (elevFromDatum + elevFromLevel) - (outsideParameter/2);

//output
elements;
bottomValues;
# ----------------------------------------
code_block_5 = CodeBlock(elements=code_block_4.out5, bottomValues=code_block_4.out6)
# ---------- code_block_5.designscript (5 lines) ----------
elements;
bottomValues;
paramName = "ACM_SOD_Bottom of Pipe Sleeve";

elementsToSet = Transaction.End(Revit.Elements.Element.SetParameterByName(elements, paramName, bottomValues));
# ----------------------------------------
code_block_6 = CodeBlock(ele=code_block_5.elementsToSet)
# ---------- code_block_6.designscript (15 lines) ----------
elements = List.Flatten(ele,-1);

isEmpty = List.IsEmpty(elements);
counts = List.Count(elements);

allowMessage = [Imperative]{
if(isEmpty == false)
	return SuccessMessage(counts);
else
	return List.Empty;
};

//output
caption = "Results!";
allowMessage;
# ----------------------------------------
ʳʰʸᵗʰᵐ_helpers_simpleusermessage = Rhythm.Revit.Helpers.Helpers.SimpleUserMessage(caption=code_block_6.out4, message=code_block_6.out5)
