# Dynamo graph TransferParameterValue_script.dyn "TransferParameterValue" (Dynamo 2.12.0.5650)
# packages: Data-Shapes 2022.2.103, Clockwork for Dynamo 2.x 2.6.0, Rhythm 2022.11.4

code_block = CodeBlock()
# ---------- code_block.designscript (3 lines) ----------
def FinalMessage(counts){
return "Successfully updated " + counts + " elements.";
};
# ----------------------------------------
code_block_2 = CodeBlock()
# ---------- code_block_2.designscript (11 lines) ----------
cats = [
"Cable Trays",
"Cable Tray Fittings",
"Conduits",
"Ducts",
"Pipes",
"Pipe Accessories",
"Duct Accessories",
"Mechanical Equipment",
"Air Terminals"
];
# ----------------------------------------
byName = Category.ByName(name=code_block_2)
code_block_3 = CodeBlock { false; }
clean = List.Clean(list=byName, preserveIndices=code_block_3)
all_elements_of_category = ElementsOfCategory(Category=clean)
parameters = Element.Parameters(element=all_elements_of_category)
name = Parameter.Name(parameter=parameters)
flatten = List.Flatten(list=name)
uniqueItems = List.UniqueItems(list=flatten)
sort = List.Sort(list=uniqueItems)
code_block_4 = CodeBlock(keys=sort, values=sort) { "Transfer from:"; keys; values; }
radiobuttons_data = Custom[RadioButtons Data](InputName=code_block_4.out0, Keys=code_block_4.keys, Values=code_block_4.values)  # package Data-Shapes; Create radio buttons input for UI.MultipleInputForm ++ .
list_create = List.Create(item0=radiobuttons_data)
boolean = BoolSelector(true)
code_block_5 = CodeBlock(inputs=list_create, toggle=boolean) { "Transfer Parameter Values"; "logo"; "Accept"; inputs; toggle; "Cancel"; 700; }
multipleinputform = Custom[MultipleInputForm ++](Description_optional=code_block_5.out0, Logo_optional=code_block_5.out1, ButtonText_optional=code_block_5.out2, Inputs=code_block_5.inputs, Toggle=code_block_5.toggle, CancelButtonText_optional=code_block_5.out5, MaxHeight_optional=code_block_5.out6)  # package Data-Shapes; Create a form with multiple inputs. see www.data-shapes.net for tutorials and infos!
code_block_6 = CodeBlock(inputs=multipleinputform.User_Inputs, wasRun=multipleinputform.Was_Run, wasCancelled=multipleinputform.Was_Cancelled)
# ---------- code_block_6.designscript (16 lines) ----------
inputs;
wasRun;
wasCancelled;

isEmpty = List.IsEmpty(inputs);

allowInput = [Imperative]{
if (isEmpty ==  false)
	return [inputs, true];
else
	return [List.Empty, false];
};

//output
paramName = allowInput[0][0];
toggle = allowInput[1];
# ----------------------------------------
passthrough = Custom[Passthrough](passThrough=all_elements_of_category, waitFor=code_block_6.out5)  # package Clockwork for Dynamo 2.x; Forces a sequential order of execution. The node wired into the output of the Passthrough node will be executed *after* the node wired into the waitFor input (e.g. important for some Revit operations). The value of the passThrough input will be passed on to the node wired into the output port of the Passthrough node.
code_block_7 = CodeBlock(paramName=code_block_6.out5) { paramName; }
parameterByName = Parameter.ParameterByName(element=passthrough, name=code_block_7)
isEmpty = List.IsEmpty(list=parameterByName@L2)
filterByBoolMask = List.FilterByBoolMask(list=passthrough, mask=isEmpty)
code_block_8 = CodeBlock(paramName=code_block_6.out5) { paramName; }
parameterByName_2 = Parameter.ParameterByName(element=filterByBoolMask.out, name=code_block_8)
isNull = Object.IsNull(object=parameterByName_2)
anyTrue = List.AnyTrue(list=isNull@L2)
filterByBoolMask_2 = List.FilterByBoolMask(list=filterByBoolMask.out, mask=anyTrue)
code_block_9 = CodeBlock(paramName=code_block_6.out5) { paramName; }
parameterByName_3 = Parameter.ParameterByName(element=filterByBoolMask_2.out, name=code_block_9)
hasValue = Parameter.HasValue(parameter=parameterByName_3)
filterByBoolMask_3 = List.FilterByBoolMask(list=filterByBoolMask_2.out, mask=hasValue)
code_block_10 = CodeBlock(paramName=code_block_6.out5) { paramName; }
getParameterValueByName = Element.GetParameterValueByName(element=filterByBoolMask_3.in, parameterName=code_block_10)
list_create_2 = List.Create(item0=filterByBoolMask_3.in, item1=getParameterValueByName)
parameters_2 = Element.Parameters(element=filterByBoolMask_3.in)
name_2 = Parameter.Name(parameter=parameters_2)
flatten_2 = List.Flatten(list=name_2)
uniqueItems_2 = List.UniqueItems(list=flatten_2)
sort_2 = List.Sort(list=uniqueItems_2)
code_block_11 = CodeBlock(keys=sort_2, values=sort_2) { "Transfer to:"; keys; values; }
radiobuttons_data_2 = Custom[RadioButtons Data](InputName=code_block_11.out0, Keys=code_block_11.keys, Values=code_block_11.values)
list_create_3 = List.Create(item0=radiobuttons_data_2)
code_block_12 = CodeBlock(inputs=list_create_3, toggle=code_block_6.out6) { "Transfer Parameter Values"; "logo"; "Accept"; inputs; toggle; "Cancel"; 700; }
multipleinputform_2 = Custom[MultipleInputForm ++](Description_optional=code_block_12.out0, Logo_optional=code_block_12.out1, ButtonText_optional=code_block_12.out2, Inputs=code_block_12.inputs, Toggle=code_block_12.toggle, CancelButtonText_optional=code_block_12.out5, MaxHeight_optional=code_block_12.out6)
code_block_13 = CodeBlock(inputs=multipleinputform_2.User_Inputs, wasRun=multipleinputform_2.Was_Run, wasCancelled=multipleinputform_2.Was_Cancelled)
# ---------- code_block_13.designscript (15 lines) ----------
inputs;
wasRun;
wasCancelled;

isEmpty = List.IsEmpty(inputs);

allowInput = [Imperative]{
if (isEmpty ==  false)
	return inputs;
else
	return List.Empty;
};

//output
allowInput[0];
# ----------------------------------------
passthrough_2 = Custom[Passthrough](passThrough=list_create_2, waitFor=code_block_13.out5)
code_block_14 = CodeBlock(pass=passthrough_2) { pass; elements = pass[0]; values = pass[1]; }
code_block_15 = CodeBlock(elements=code_block_14.elements, paramName=code_block_13.out5, values=code_block_14.values) { elements; paramName; values; }
setParameterByName = Element.SetParameterByName(element=code_block_15.elements, parameterName=code_block_15.paramName, value=code_block_15.values)
flatten_3 = List.Flatten(list=setParameterByName)
end = Revit.Transaction.Transaction.End(input=flatten_3)
code_block_16 = CodeBlock(elements=end)
# ---------- code_block_16.designscript (12 lines) ----------
elements;

isEmpty = List.IsEmpty(elements);
counts = List.Count(elements);

"Results!";
allowMessage = [Imperative]{
if (isEmpty == false)
	return FinalMessage(counts);
else
	return List.Empty;
};
# ----------------------------------------
ʳʰʸᵗʰᵐ_helpers_simpleusermessage = Rhythm.Revit.Helpers.Helpers.SimpleUserMessage(caption=code_block_16.out3, message=code_block_16.out4)
code_block_17 = CodeBlock { counts = 5; message = FinalMessage(counts); }
watch = Watch(code_block_16.out1)
watch_2 = Watch(code_block_16.out2)
